# Grasshopper definition 03_ForceFlowLines.gh (Grasshopper 1.0.7)
# plug-ins: Karamba3D, Human

# ---- group: Set Cross Sections
cross_section = CrossSectionKaramba3D(FamilyNameOfCrossSection="DefaultCroSec", Diameter_in=4.5, WallThickness_in=expr("x*0.5", "0.1"), mode="Circular Hollow")

# ----
line_thickness = Slider(8.4, range=0..10)
line_thickness_2 = GetNumber(line_thickness, AtLeast=0, AtMost=15, Maximum=1.797693135e+308, Minimum=-1.797693135e+308, TreeAccess=False)

# ---- group: Generate Surface for Shell
plane_length = Slider(2.49, range=1..5)
plane_height = Slider(3.29, range=1..10)
panel = Panel("0")
# 03 - Force Flow Lines
# Difficulty: Moderate | Version: 2.2.0
# Visualise force flow lines in shells. For details see: H. Moldenhauer: Die Visualisierung des Kraftflusses in Stahlkonstruktionen, in 'Stahlbau', Volume 81, Issue 1, pages 32-40,Ernst & Sohn, 2012.
xz = XZPlane(Origin=Point(0, 0, 0))

# ----
plane_height_2 = GetNumber(plane_height, AtLeast=0, AtMost=10, Maximum=1.797693135e+308, Minimum=-1.797693135e+308, TreeAccess=False)
plane_length_2 = GetNumber(plane_length, AtLeast=0, AtMost=10, Maximum=1.797693135e+308, Minimum=-1.797693135e+308, TreeAccess=False)

# ---- group: Generate Surface for Shell (continued)
dom = ConstructDomain(DomainStart=panel, DomainEnd=plane_length_2)
dom_2 = ConstructDomain(DomainStart=panel, DomainEnd=plane_height_2)
planesrf = PlaneSurface(Plane=xz, XSize=dom, YSize=dom_2)

# ---- group: Define Mesh for Shell
hole_radius = Slider(1.3, range=0.1..2)
xz_2 = XZPlane(Origin=Point(0, 0, 0))
mesh_resolution = Slider(0.05, range=0.05..1)

# ----
hole_radius_2 = GetNumber(hole_radius, AtLeast=0, AtMost=3, Maximum=1.797693135e+308, Minimum=-1.797693135e+308, TreeAccess=False)
mesh_resolution_2 = GetNumber(mesh_resolution, AtLeast=0, AtMost=1, Maximum=1.797693135e+308, Minimum=-1.797693135e+308, TreeAccess=False)

# ---- group: Define Mesh for Shell (continued)
cir = Circle(Plane=xz_2, Radius=hole_radius_2)
boundary = BoundarySurfaces(Edges=cir)
rdiff = RegionDifference(CurvesA=planesrf, CurvesB=boundary)
boundary_2 = BoundarySurfaces(Edges=rdiff)
mesh_breps = MeshBrepsKaramba3D(
    Brep=boundary_2,
    MeshResolution=mesh_resolution_2,
    EdgeRefinementFactor=0.67,
    PointReduction=False,
    SmoothingStepSize="1.0",
    SmoothingIterations=5)  # -> Mesh, Info
meshtoshell = MeshToShellKaramba3D(Mesh=mesh_breps.Mesh, LimitDistance_ft=0.005)  # -> Element, Points, Info

# ---- group: Define Lines for DummyBeams
dom_3 = ConstructDomain(DomainStart=plane_height, DomainEnd=plane_height)
points_from_xyz = PointsFromXYZ(point=meshtoshell.Points, Z=dom_3, tolerance=0.001)
pdecon = Deconstruct(Point=points_from_xyz)  # -> XComponent, YComponent, ZComponent
sort = SortList(Keys=pdecon.XComponent, ValuesA=points_from_xyz)  # -> Keys, ValuesA
panel_2 = Panel("DummyBeam")
pline = PolyLine(Vertices=sort.ValuesA, Closed=False)
explode = Explode(Curve=pline, Recursive=True)  # -> Segments, Vertices
linetobeam = LineToBeamKaramba3D(
    Line=explode.Segments,
    Identifier=panel_2,
    CrossSection=cross_section,
    New=True,
    Remove=True,
    LimitDistance_ft=0.005,
    Bending=True,
    SetBucklingLength=True,
    ToPolylineMaxAngle=0.03,
    ToPolylineTolerance=0.01,
    ToPolylineMinEdgeLength=0.25)  # -> Element, Points, Info

# ---- group: Define Loads
Z = UnitZ(Factor="-10")
beam_loads = BeamLoadsKaramba3D(BeamIdentifier=panel_2, LoadCase="0", ForceVector=Z, TStart=0, TEnd=1, mode="Block", menu=[buttons(on, off, off)])

# ---- group: Define Supports
points_from_xyz_2 = PointsFromXYZ(point=meshtoshell.Points, Z=panel, tolerance=0.001)
points_from_xyz_3 = PointsFromXYZ(point=meshtoshell.Points, X="0", tolerance=0.001)
supp = SupportKaramba3D(PosInd=points_from_xyz_2, menu=[buttons(off, on, on, off, on, off)])
supp_2 = SupportKaramba3D(PosInd=points_from_xyz_3, menu=[buttons(on, on, off, off, off, off)])

# ---- group: Mirror Mesh
cluster = Cluster(mesh=mesh_breps.Mesh)

# ----
load = LoadKaramba3D(flatten(beam_loads))

# ---- group: Assemble Model
element = ElementKaramba3D(flatten([meshtoshell.Element, linetobeam.Element]))
support = SupportKaramba3D(flatten([supp, supp_2]))
assemble = AssembleModelKaramba3D(Elem=element, Support=support, Load=load, LimitDistance_m=0.005)  # -> Model, Info, Mass_kg, CenterOfGravity, LoadCaseNames

# ---- group: Analyze Model
analyze = AnalyzeKaramba3D(Model=assemble.Model)  # -> CalculatedModel, MaximumDisplacement_cm, ResultingForceOfGravity_kN, ElasticEnergyChange_kNm

# ---- group: View Results
modelview = ModelViewKaramba3D(Model=analyze.CalculatedModel, ResultFactors=1, ResultCase=-1)  # -> Model, DeformedMesh, DeformedAxes, DeformedModel
shellview = ShellViewKaramba3D(Model=modelview.Model, IndexOfLayer=0)  # -> Model, MeshesOfRenderedShells, LegendColors, LegendTags
legend = Legend(Colour=shellview.LegendColors, Tags=shellview.LegendTags, LegendType=1)  # disabled

# ---- group: Mirror Mesh
cluster_2 = Cluster(mesh=shellview.MeshesOfRenderedShells)

# ---- group: Shell Forces
end = EndPoints(Curve=pline)  # -> Start, End; disabled
ln = Line(StartPoint=end.Start, EndPoint=end.End)  # disabled
number_slider = Slider(0.66, range=0..1)  # disabled
midpt = CurveMiddle(Curve=ln)  # disabled
num = Number(plane_height)  # disabled
multiplication = Multiplication(A=num, B=number_slider)  # disabled
panel_3 = Panel("0.99")  # disabled
Z_2 = UnitZ(Factor=expr("-x", multiplication))  # disabled
scale = Scale(Geometry=ln, Center=midpt, Factor=panel_3)  # -> Geometry, Transform; disabled
move = Move(Geometry=scale.Geometry, Motion=Z_2)  # -> Geometry, Transform; disabled
Y = UnitY(Factor=1)  # disabled
s_forces = ShellSectionKaramba3D(
    AnalyzedModel=shellview.Model,
    Polyline=move.Geometry,
    ProjectionDirection=Y,
    mode="Forces",
    menu=[checkbox(on), checkbox(on), checkbox(off), slider(9), slider(0.1), slider(1), checkbox(on), checkbox(on), checkbox(off), checkbox(off), checkbox(off), checkbox(off), checkbox(off), checkbox(off), checkbox(off), slider(1)])  # -> AnalyzedModel, Polylines, FaceIndexes, MeshesOfRenderedResults, CurvesOfRenderedResults, Ntt_kN_m, Nnn_kN_m, Ntn_kN_m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; disabled

# ---- group: Line Results on Shells
debrep = DeconstructBrep(Brep=boundary_2)  # -> Faces, Edges, Vertices
item = ListItem(List=debrep.Edges, Index=0, Wrap=True)  # -> Item1, Item
Z_3 = UnitZ(Factor="-1")
Y_2 = UnitY(Factor="1")
divide = DivideCurve(Curve=item.Item1, Count=10, Kinks=False)  # -> Points, Tangents, Parameters; disabled
rot3d = Rotate3D(Geometry=Z_3, Angle=degrees(Slider(0, range=0..90)), Center=Point(0, 0, 0), Axis=Y_2)  # -> Geometry, Transform
pt = Point(flatten([sort.ValuesA, divide.Points]))
shelllineresults = LineResultsOnShellsKaramba3D(
    AnalyzedModel=shellview.Model,
    LayerPosition=0,
    GlobalForceDirections=rot3d.Geometry,
    ListOfSourcesOfForceFlowLinesLinesPoints=pt,
    SegmentLength_m=0.5,
    DA_deg=5,
    Theta_deg=Slider(0, range=0..90),
    mode="ForceFlow")  # -> AnalyzedModel, Lines
vdis = VectorDisplay(Anchor="0,0,0", Vector=rot3d.Geometry)

# ---- group: Shell Forces from Force Flow Lines
panel_4 = Panel("-0.05")  # disabled
Y_3 = UnitY(Factor=panel_4)  # disabled
move_2 = Move(Geometry=shelllineresults.Lines, Motion=Y_3)  # -> Geometry, Transform; disabled
number_slider_2 = Slider(21, range=0..54)  # disabled
join = JoinCurves(Curves=move_2.Geometry, Preserve=False)  # disabled
swatch = ColourSwatch(SwatchColor=RGB(255, 255, 255))  # disabled
item_2 = ListItem(List=flatten(join), Index=number_slider_2, Wrap=True)  # disabled
preview = CustomPreview(Geometry=item_2, Material=swatch)  # disabled
s_forces_2 = ShellSectionKaramba3D(
    AnalyzedModel=shellview.Model,
    Polyline=join,
    ProjectionDirection=Y,
    mode="Forces",
    menu=[checkbox(on), checkbox(on), checkbox(off), slider(8), slider(0.1), slider(1), checkbox(on), checkbox(on), checkbox(off), checkbox(off), checkbox(off), checkbox(off), checkbox(off), checkbox(off), checkbox(off), slider(1)])  # -> AnalyzedModel, Polylines, FaceIndexes, MeshesOfRenderedResults, CurvesOfRenderedResults, Ntt_kN_m, Nnn_kN_m, Ntn_kN_m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; disabled

# ---- group: Mirror Mesh
cluster_3 = Cluster_2(crv=shelllineresults.Lines)

# ----
previewlw = CustomPreviewLineweights(Geometry=cluster_3, Shader=ColourSwatch(SwatchColor=RGB(0, 0, 0)), Thickness=line_thickness_2, Absolute=False)
crv = Curve(flatten(cluster_3))
mesh = Mesh(cluster_2)
lineouttput = ContextBake(Geometry=flatten(crv))
meshoutput = ContextBake(Geometry=mesh)

# ==== cluster PointsFromXYZ
tolerance = ClusterInput()
point = ClusterInput()
X = ClusterInput()
Y = ClusterInput()
Z = ClusterInput()
tolerance_2 = Number(tolerance)
point_2 = Point(point)
X_2 = Domain(X)
Y_2 = Domain(Y)
Z_2 = Domain(Z)
deconstruct = Deconstruct(Point=point_2)  # -> XComponent, YComponent, ZComponent
deconstruct_domain = DeconstructDomain(Domain=X_2)  # -> Start, End
deconstruct_domain_2 = DeconstructDomain(Domain=Y_2)  # -> Start, End
deconstruct_domain_3 = DeconstructDomain(Domain=Z_2)  # -> Start, End
absolute = Absolute(Value=tolerance_2)
subtraction = Subtraction(A=deconstruct_domain.Start, B=absolute)
addition = Addition(A=deconstruct_domain.End, B=absolute)
subtraction_2 = Subtraction(A=deconstruct_domain_2.Start, B=absolute)
addition_2 = Addition(A=deconstruct_domain_2.End, B=absolute)
subtraction_3 = Subtraction(A=deconstruct_domain_3.Start, B=absolute)
addition_3 = Addition(A=deconstruct_domain_3.End, B=absolute)
number = Number(deconstruct.XComponent)
number_2 = Number(deconstruct.YComponent)
number_3 = Number(deconstruct.ZComponent)
larger_than = LargerThan(FirstNumber=number, SecondNumber=subtraction)  # -> LargerThan, OrEqualTo
smaller_than = SmallerThan(FirstNumber=number, SecondNumber=addition)  # -> SmallerThan, OrEqualTo
larger_than_2 = LargerThan(FirstNumber=number_2, SecondNumber=subtraction_2)  # -> LargerThan, OrEqualTo
smaller_than_2 = SmallerThan(FirstNumber=number_2, SecondNumber=addition_2)  # -> SmallerThan, OrEqualTo
larger_than_3 = LargerThan(FirstNumber=number_3, SecondNumber=subtraction_3)  # -> LargerThan, OrEqualTo
smaller_than_3 = SmallerThan(FirstNumber=number_3, SecondNumber=addition_3)  # -> SmallerThan, OrEqualTo
gate_and = GateAnd(A=larger_than.OrEqualTo, B=smaller_than.OrEqualTo)
gate_and_2 = GateAnd(A=larger_than_2.OrEqualTo, B=smaller_than_2.OrEqualTo)
gate_and_3 = GateAnd(A=larger_than_3.OrEqualTo, B=smaller_than_3.OrEqualTo)
c_script = CSharpScript(value=X_2, bool=gate_and)  # -> out, result
# ---------- c_script: C# ----------
    if(_value == null)
      result_ = true;
    else result_ = _bool;
# ---------- end c_script ----------
c_script_2 = CSharpScript(value=Y_2, bool=gate_and_2)  # -> out, result; same code as c_script
c_script_3 = CSharpScript(value=Z_2, bool=gate_and_3)  # -> out, result; same code as c_script
gate_and_4 = GateAnd(A=c_script.result, B=c_script_2.result)
gate_and_5 = GateAnd(A=gate_and_4, B=c_script_3.result)
point_3 = Point(point_2)
cull_pattern = CullPattern(List=point_3, CullPattern=gate_and_5)
point_4 = Point(cull_pattern)
point_5 = ClusterOutput(point_4)

# ==== cluster Cluster
mesh = ClusterInput()
yz = YZPlane(Origin=Point(0, 0, 0))
mesh_2 = Mesh(mesh)
mirror = Mirror(Geometry=mesh_2, Plane=yz)  # -> Geometry, Transform
xy = XYPlane(Origin=Point(0, 0, 0))
mirror_2 = Mirror(Geometry=[mirror.Geometry, mesh_2], Plane=xy)  # -> Geometry, Transform
mesh_3 = Mesh([mirror.Geometry, mesh_2, mirror_2.Geometry])
mesh_4 = ClusterOutput(mesh_3)

# ==== cluster Cluster_2
crv = ClusterInput()
crv_2 = Curve(crv)
yz = YZPlane(Origin=Point(0, 0, 0))
mirror = Mirror(Geometry=crv_2, Plane=yz)  # -> Geometry, Transform
xy = XYPlane(Origin=Point(0, 0, 0))
mirror_2 = Mirror(Geometry=[mirror.Geometry, crv_2], Plane=xy)  # -> Geometry, Transform
crv_3 = Curve([mirror_2.Geometry, mirror.Geometry, crv_2])
crv_4 = ClusterOutput(crv_3)
