# Grasshopper definition ladybug_test02.gh (Grasshopper 1.0.7)
# plug-ins: Human

panel = Panel("https://climate.onebuilding.org/WMO_Region_4_North_and_Central_America/USA_United_States_of_America/NY_New_York/USA_NY_New.York-Downtown.Manhattan.Heli.720553_TMYx.zip")
sqgrid = Square(Plane=PlaneXY(0, 0, 0), Size=1, ExtentX=5, ExtentY=5)  # -> Cells, Points
tstat = TreeStatistics(Tree=sqgrid.Cells)  # -> Paths, Length, Count
downloadepw = LBDownloadWeather(weather_URL=panel)  # -> epw_file, stat_file, ddy_file; plug-in component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
epwmap = LBEPWmap(epw_map=Toggle(True))  # -> report; plug-in component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
dpath = DeconstructPath(Branch=tstat.Paths)
item = ListItem(List=dpath, Index=-1, Wrap=True)  # -> flatten(Item)
panel_2 = Panel(downloadepw.epw_file)
previewlw = CustomPreviewLineweights(Geometry=sqgrid.Cells, Shader=ColourSwatch(SwatchColor=RGB(0, 0, 0)), Thickness=item, Absolute=False)
importepw = LBImportEPW(epw_file=downloadepw.epw_file)  # -> location, dry_bulb_temperature, dew_point_temperature, relative_humidity, wind_speed, wind_direction, direct_normal_rad, diffuse_horizontal_rad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; plug-in component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
hourlyplot = LBHourlyPlot(data=importepw.dry_bulb_temperature)  # -> report, mesh, legend, borders, labels, title, vis_set; plug-in component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
mesh = Mesh(hourlyplot.mesh)
context_bake = ContextBake(Geometry=mesh)
