# Grasshopper definition test_karamba.gh (Grasshopper 1.0.7)

# ---- group: Generate Surface for Shell
plane_length = Slider(2.49, range=1..5)
plane_height = Slider(3.29, range=1..10)
xz = XZPlane(Origin=Point(0, 0, 0))

# ----
plane_height_2 = GetNumber(plane_height, AtLeast=0, AtMost=10, Maximum=1.797693135e+308, Minimum=-1.797693135e+308, TreeAccess=False)
plane_length_2 = GetNumber(plane_length, AtLeast=0, AtMost=10, Maximum=1.797693135e+308, Minimum=-1.797693135e+308, TreeAccess=False)

# ---- group: Generate Surface for Shell (continued)
dom = ConstructDomain(DomainStart="0", DomainEnd=plane_length_2)
dom_2 = ConstructDomain(DomainStart="0", DomainEnd=plane_height_2)
planesrf = PlaneSurface(Plane=xz, XSize=dom, YSize=dom_2)

# ---- group: Define Mesh for Shell
hole_radius = Slider(1.3, range=0.1..2)
xz_2 = XZPlane(Origin=Point(0, 0, 0))

# ----
hole_radius_2 = GetNumber(hole_radius, AtLeast=0, AtMost=3, Maximum=1.797693135e+308, Minimum=-1.797693135e+308, TreeAccess=False)

# ---- group: Define Mesh for Shell (continued)
cir = Circle(Plane=xz_2, Radius=hole_radius_2)
boundary = BoundarySurfaces(Edges=cir)
rdiff = RegionDifference(CurvesA=planesrf, CurvesB=boundary)
boundary_2 = BoundarySurfaces(Edges=rdiff)

# ---- group: Mirror Mesh
cluster = Cluster(mesh=boundary_2)

# ----
context_bake = ContextBake(Geometry=cluster)

# ==== cluster Cluster
mesh = ClusterInput()
yz = YZPlane(Origin=Point(0, 0, 0))
mesh_2 = Mesh(mesh)
mirror = Mirror(Geometry=mesh_2, Plane=yz)  # -> Geometry, Transform
xy = XYPlane(Origin=Point(0, 0, 0))
mirror_2 = Mirror(Geometry=[mirror.Geometry, mesh_2], Plane=xy)  # -> Geometry, Transform
mesh_3 = Mesh([mirror.Geometry, mesh_2, mirror_2.Geometry])
mesh_4 = ClusterOutput(mesh_3)
